# Dynamo graph Add specified shared one parameter to families from folder with exclusion folder.dyn "Массовое добавление параметра ФОП в семейства из папки с папкой исключением" (Dynamo 3.6.1.9895)

directory_path = Directory("S:\ㅤМежпроектные данные\00.  ООО ПИ «АЛЬТАИР»\02. Библиотека семейств Autodesk Revit")
directory_from_path = DirectoryObject(path=directory_path)
boolean = BoolSelector(true)
getDirectoryContents = FileSystem.GetDirectoryContents(directory=directory_from_path, includeSubdirectories=boolean)
string = StringInput(".rfa")
endsWith = String.EndsWith(string=getDirectoryContents.files, searchFor=string)
filterByBoolMask = List.FilterByBoolMask(list=getDirectoryContents.files, mask=endsWith)
string_2 = StringInput("GKES_Сметы_Расчет расхода")
string_3 = StringInput("01 Обязательные ОБЩИЕ")
boolean_2 = BoolSelector(true)
directory_path_2 = Directory("S:\ㅤМежпроектные данные\00.  ООО ПИ «АЛЬТАИР»\02. Библиотека семейств Autodesk Revit\00_ОБЩИЕ")
python_script = Python(IN[0]=filterByBoolMask.in, IN[1]=string_2, IN[2]=string_3, IN[3]=boolean_2, IN[4]=directory_path_2)  # CPython3
# ---------- python_script.python (93 lines) ----------
import clr
import re  # Импортируем регулярные выражения для фильтрации бэкапов

# Импортируем службы Dynamo для работы с документом
clr.AddReference('RevitServices')
from RevitServices.Persistence import DocumentManager

# Импортируем API Revit
clr.AddReference('RevitAPI')
from Autodesk.Revit.DB import *

# Получаем доступ к приложению Revit
app = DocumentManager.Instance.CurrentUIApplication.Application

# Входные данные из нодов Dynamo (строго по порядку)
fam_paths = IN[0]
param_name = IN[1]
group_text = IN[2]  
is_instance = IN[3]
exclude_folder_path = IN[4]  # ПУТЬ К ПАПКЕ-ИСКЛЮЧЕНИЮ ИЗ НОДА DIRECTORY PATH

# Превращаем входной путь в список, если подан всего один файл
if not isinstance(fam_paths, list):
    fam_paths = [fam_paths]

# 1. Открываем ФОП и ищем определение параметра
def_file = app.OpenSharedParameterFile()
target_def = None

if def_file:
    for group in def_file.Groups:
        target_def = group.Definitions.get_Item(param_name)
        if target_def:
            break

# Список для сбора результатов по каждому файлу
results = []

if not target_def:
    results.append("Параметр не найден в ФОП или ФОП не подключен в Revit.")
else:
    # 2. Получаем правильный ForgeTypeId для группы параметров
    try:
        param_group = getattr(GroupTypeId, group_text)
    except AttributeError:
        param_group = GroupTypeId.Data

    # 3. Запускаем цикл по всем путям к семействам
    for path in fam_paths:
        if path is None: 
            continue
            
        # ПРОВЕРКА ИСКЛЮЧЕНИЯ: если путь файла начинается с пути исключаемой папки
        if exclude_folder_path and exclude_folder_path.lower() in path.lower():
            results.append(f"{path} -> Пропущен (находится в исключенной папке)")
            continue
            
        # Проверяем, не является ли файл бэкапом вида .0001.rfa
        if re.search(r"\.\d{4}\.rfa$", path, re.IGNORECASE):
            results.append(f"{path} -> Пропущен (это файл резервной копии)")
            continue
            
        try:
            # Открываем семейство в фоновом режиме
            fam_doc = app.OpenDocumentFile(path)
            
            if fam_doc.IsFamilyDocument:
                fam_manager = fam_doc.FamilyManager
                
                # Добавляем параметр через транзакцию
                tx = Transaction(fam_doc, "Add Shared Parameter")
                tx.Start()
                try:
                    fam_manager.AddParameter(target_def, param_group, is_instance)
                    tx.Commit()
                    
                    # Сохраняем и закрываем файл семейства
                    fam_doc.Save()
                    fam_doc.Close(False)
                    results.append(f"{path} -> Успешно добавлен")
                except Exception as e:
                    tx.RollBack()
                    fam_doc.Close(False)
                    results.append(f"{path} -> Ошибка добавления: {str(e)}")
            else:
                fam_doc.Close(False)
                results.append(f"{path} -> Файл не является семейством (.rfa)")
                
        except Exception as e:
            results.append(f"{path} -> Не удалось открыть файл: {str(e)}")

# Выводим отчет по каждому файлу на выход нода
OUT = results
# ----------------------------------------
watch = Watch(python_script)
