# Dynamo graph Overwrite family versions up to 2026.dyn "Перезапись_версии семейст до_2026" (Dynamo 3.6.1.9895)

directory_path = Directory("C:\Users\popovvs1\Desktop\JOB\REVIT\Семейства\01. В работе")
python_script = Python(IN[0]=directory_path)  # CPython3
# ---------- python_script.python (78 lines) ----------
import clr
import System
import os

clr.AddReference('RevitServices')
import RevitServices
from RevitServices.Transactions import TransactionManager

clr.AddReference('RevitAPI')
import Autodesk
from Autodesk.Revit.DB import *

# НАДЕЖНОЕ ИЗВЛЕЧЕНИЕ СТРОКИ ПУТИ (РЕШЕНИЕ ПРОБЛЕМЫ TYPEERROR)
raw_input = IN
if isinstance(raw_input, list):
    root_folder = str(raw_input[0]) if len(raw_input) > 0 else ""
else:
    root_folder = str(raw_input)

# Очищаем от возможных случайных пробелов по краям
root_folder = root_folder.strip()

app = RevitServices.Persistence.DocumentManager.Instance.CurrentUIApplication.Application
log = []

open_options = OpenOptions()
open_options.DetachFromCentralOption = DetachFromCentralOption.DoNotDetach

# --- ЭТАП 1: Предварительная очистка старых бэкапов перед запуском ---
deleted_backups_count = 0
if root_folder and os.path.isdir(root_folder):
    for root, dirs, files in os.walk(root_folder):
        for file in files:
            # Ищем файлы, у которых перед расширением есть .00xx
            if file.lower().endswith('.rfa') and len(file) > 9 and file[-9:-4].isdigit() and file[-10] == '.':
                try:
                    os.remove(os.path.join(root, file))
                    deleted_backups_count += 1
                except:
                    pass

if deleted_backups_count > 0:
    log.append("Удалено старых бэкапов до начала обновления: {}".format(deleted_backups_count))
    log.append("-" * 50)

# --- ЭТАП 2: Сбор чистых файлов семейств для обновления ---
file_paths = []
if root_folder and os.path.isdir(root_folder):
    for root, dirs, files in os.walk(root_folder):
        for file in files:
            if file.lower().endswith('.rfa'):
                # Дополнительная проверка, чтобы точно не взять бэкап
                is_backup = len(file) > 9 and file[-9:-4].isdigit() and file[-10] == '.'
                if not is_backup:
                    file_paths.append(os.path.join(root, file))

# --- ЭТАП 3: Обновление семейств и финальная зачистка ---
if not file_paths:
    log.append("Файлы .rfa в указанной папке не найдены. Проверенный путь: " + root_folder)
else:
    for path in file_paths:
        try:
            model_path = ModelPathUtils.ConvertUserVisiblePathToModelPath(path)
            family_doc = app.OpenDocumentFile(model_path, open_options)
            
            family_doc.Save()
            family_doc.Close(False)
            log.append("Успешно обновлено: " + path)
            
            # Сразу после сохранения удаляем свежесозданный бэкап .0001.rfa
            backup_path = path[:-4] + ".0001.rfa"
            if os.path.exists(backup_path):
                os.remove(backup_path)
                
        except Exception as e:
            log.append("ОШИБКА при обработке " + path + ": " + str(e))

OUT = log
# ----------------------------------------
watch = Watch(python_script)
