# Dynamo graph Place family instances in project using Excel links.dyn "БД_Фильтр_ADSK_расставить экз семейств в проекте по ссылкам из эксель" (Dynamo 3.6.1.9895)

file_path = Filename("..\Семейства\Таблицы семейств\БД_свойств_семейств_матрица_параметров_15.09.2026.xlsm")
string_from_object = FromObject(object=file_path)
string = StringInput("ADSK")
number = DoubleInput(0)
boolean = BoolSelector(true)
openXMLImportExcel = Data.OpenXMLImportExcel(filePath=string_from_object, sheetName=string, startRow=number, startColumn=number, readAsString=boolean)
flatten = List.Flatten(list=openXMLImportExcel)
number_2 = DoubleInput(1000)
python_script = Python(IN[0]=flatten, IN[1]=number_2)  # CPython3
# ---------- python_script.python (120 lines) ----------
import clr
import System

clr.AddReference('RevitServices')
import RevitServices
from RevitServices.Persistence import DocumentManager
from RevitServices.Transactions import TransactionManager

clr.AddReference('RevitAPI')
import Autodesk
from Autodesk.Revit.DB import *
from Autodesk.Revit.DB.Structure import StructuralType

doc = DocumentManager.Instance.CurrentDBDocument

# Получаем данные со входов Dynamo
raw_data = IN[0]   # Таблица из Excel (Вход IN[0])
step_mm = IN[1]    # Величина смещения в мм (Вход IN[1])

# Переводим шаг смещения из мм в футы Revit
try:
    step_feet = float(step_mm) / 304.8
except:
    step_feet = 1000.0 / 304.8 # Шаг по умолчанию (1 метр), если на вход ничего не подали

# Извлекаем чистые пути к файлам семейства
paths = []
if isinstance(raw_data, list):
    for item in raw_data:
        if isinstance(item, list):
            for subitem in item:
                if subitem and ".rfa" in str(subitem).lower():
                    paths.append(str(subitem).strip())
        elif item and ".rfa" in str(item).lower():
            paths.append(str(item).strip())

# Собираем уровни проекта для размещения
all_levels = FilteredElementCollector(doc).OfClass(Level).ToElements()
base_level = all_levels[0] if len(all_levels) > 0 else None

created_instances = []

# Начальная координата X (начнем с 0)
current_x_feet = 0.0
default_y_feet = 0.0
default_z_feet = 0.0

TransactionManager.Instance.EnsureInTransaction(doc)

# Жестко указываем CPython3 перегрузку LoadFamily, принимающую только строку
load_family_by_path = doc.LoadFamily.Overloads[System.String]

for path in paths:
    fam_name = path.split('\\')[-1].replace('.rfa', '').strip()
    family = None
    
    try:
        # 1. Проверяем, загружено ли семейство в проект
        for f in FilteredElementCollector(doc).OfClass(Family):
            if f.Name.lower() == fam_name.lower():
                family = f
                break
                
        # 2. Если семейства нет в памяти проекта — загружаем его универсальным вызовом
        if not family:
            # Исправлено: принимаем одиночный результат загрузки (без распаковки кортежа)
            loaded_result = load_family_by_path(path)
            
            # Если вернулся объект типа Family
            if isinstance(loaded_result, Family):
                family = loaded_result
            # Если вернулся bool (True) или объект загрузился, ищем его в базе проекта по имени
            else:
                for f in FilteredElementCollector(doc).OfClass(Family):
                    if f.Name.lower() == fam_name.lower():
                        family = f
                        break
        
        # 3. Если семейство успешно найдено или загружено — создаем его экземпляр
        if family:
            symbols_ids = list(family.GetFamilySymbolIds())
            if symbols_ids and len(symbols_ids) > 0:
                first_symbol_id = symbols_ids[0]
                symbol = doc.GetElement(first_symbol_id)
                
                if not symbol.IsActive:
                    symbol.Activate()
                
                # Создаем точку со смещением по оси X
                target_point = XYZ(current_x_feet, default_y_feet, default_z_feet)
                
                # Размещаем элемент
                if base_level:
                    instance = doc.Create.NewFamilyInstance(target_point, symbol, base_level, StructuralType.NonStructural)
                else:
                    instance = doc.Create.NewFamilyInstance(target_point, symbol, StructuralType.NonStructural)
                
                if instance:
                    current_x_mm = round(current_x_feet * 304.8)
                    created_instances.append("Успешно создан: {} (X = {} мм)".format(fam_name, current_x_mm))
                    
                    # Увеличиваем координату X на заданный шаг для следующего прибора
                    current_x_feet += step_feet
                else:
                    created_instances.append("Ошибка генерации экземпляра: " + fam_name)
            else:
                created_instances.append("В семействе отсутствуют типы: " + fam_name)
        else:
            created_instances.append("Не удалось загрузить rfa-файл: " + fam_name)
            
    except Exception as e:
        created_instances.append("Сбой на элементе {}: {}".format(fam_name, str(e)))

TransactionManager.Instance.TransactionTaskDone()

# Выводим финальный отчет в нод Watch
if not created_instances:
    OUT = ["Скрипт не обнаружил путей к файлам семейства .rfa."]
else:
    OUT = created_instances
# ----------------------------------------
watch = Watch(python_script)
